# Grasshopper definition circle with n cuts.gh (Grasshopper 1.0.7)

radius = Slider(32, range=5..100)
panel = Panel("Radius")
circle = Circle(Plane=PlaneXY(0, 0, 0), Radius=radius)

# ---- group: Orienting Slots
# Depth of slot in polygon
# Width of slot in polygon, should correspond to material thickness
# Don't need to shift the rectangles out for trimming since they'll naturally intersect with circle due to shape.
rect_height = Slider(4, range=1..100)
point_on_curve = PointOnCurve(circle, parameter=0.5)
rectangle = Rectangle(Plane=point_on_curve, XSize=Slider(10, range=0..100), YSize=rect_height, Radius=0)  # -> Rectangle, Length
division = Division(A=rect_height, _2=-2)
unit_y = UnitY(Factor=division)
panel_2 = Panel("Number of slots")
sides = Slider(8, range=3..100)
move = Move(Geometry=rectangle.Rectangle, Motion=unit_y)  # -> Geometry, Transform
polar_array = PolarArray(Geometry=move.Geometry, Plane=PlaneXY(0, 0, 0), Count=sides, Angle=6.283185307)  # -> Geometry, Transform

# ---- group: Inner circle
panel_3 = Panel("Inner circle radius")
circle_2 = Circle(Plane=PlaneXY(0, 0, 0), Radius=Slider(20, range=0..100))

# ---- group: Cutting slots out of curve
trim_with_regions = TrimWithRegions(Curve=polar_array.Geometry, Regions=circle)  # -> Inside, Outside
trim_with_regions_2 = TrimWithRegions(Curve=circle, Regions=polar_array.Geometry)  # -> Inside, Outside
join_curves = JoinCurves(Curves=flatten([trim_with_regions.Inside, trim_with_regions_2.Outside, circle_2]), Preserve=False)
