# Grasshopper definition boxes with slots.gh (Grasshopper 1.0.7)

number_slider = Slider(1.3, range=0.1..2)
# Gap between each slot
number_slider_2 = Slider(4, range=0..10)
# Extra length to allow trimming
number_slider_3 = Slider(0.5, range=0..1)
# Height of each slot
number_slider_4 = Slider(4, range=0..10)
panel = Panel("Depth of material")
panel_2 = Panel("Square size")
number_slider_5 = Slider(20, range=5..50)
# Creates 1 side of a square box with tabs and slots (with dogbones), that if milled 6 times, can create a cube.
rectangle = Rectangle(Plane=PlaneXY(0, 0, 0), XSize=number_slider_5, YSize=number_slider_5, Radius=0)  # -> Rectangle, Length

# ----
# Number of slots that will be created. Based on slot height and desired gap between each slot
addition = Addition(A=number_slider_2, B=number_slider_4)
division = Division(A=number_slider_5, B=addition)
round = Round(Number=division)  # -> Nearest, Floor, Ceiling
panel_3 = Panel(round.Floor)

addition_2 = Addition(A=number_slider_3, B=number_slider)

# ----
# This value consists of the slots + the gap between the slots. But slots only have gaps between each of them, so we need to subtract one extra "gap" from the end
# Distance the slots will be from the top and bottom edge. The leftover amount of space/2
multiplication = Multiplication(A=addition, B=round.Floor)
subtraction = Subtraction(A=multiplication, B=number_slider_2)
subtraction_2 = Subtraction(A=number_slider_5, B=subtraction)
division_2 = Division(A=subtraction_2, B=Slider(2, range=0..10))
panel_4 = Panel(division_2)

rectangle_2 = Rectangle(Plane=PlaneXY(0, 0, 0), XSize=addition_2, YSize=number_slider_4, Radius=0)  # -> Rectangle, Length
subtraction_3 = Subtraction(A=number_slider_5, B=division_2)

# ----
# Create am array of the slots downwards (makeshift for loop)
subtraction_4 = Subtraction(A=subtraction_3, B=number_slider_4)
negative = Negative(Value=number_slider_3)
vector_xyz = VectorXYZ(XComponent=negative, YComponent=subtraction_4, ZComponent=0)  # -> Vector, Length
negative_2 = Negative(Value=addition)
unit_y = UnitY(Factor=negative_2)
move = Move(Geometry=rectangle_2.Rectangle, Motion=vector_xyz.Vector)  # -> Geometry, Transform
linear_array = LinearArray(Geometry=move.Geometry, Direction=unit_y, Count=round.Floor)  # -> Geometry, Transform
panel_5 = Panel("Left slots")

unit_x = UnitX(Factor=number_slider_5)
move_2 = Move(Geometry=linear_array.Geometry, Motion=unit_x)  # -> Geometry, Transform
panel_6 = Panel("Right slots")

rotate = Rotate(Geometry=linear_array.Geometry, Angle=degrees(Slider(-90, range=-360..360)), Plane=PlaneXY(0, 0, 0))  # -> Geometry, Transform
panel_7 = Panel("Bottom slots")

vector_xyz_2 = VectorXYZ(XComponent=number_slider, YComponent=division_2, ZComponent=0)  # -> Vector, Length

# ----
# Create circles for dogbones, one on each inner angle
unit_y_2 = UnitY(Factor=number_slider_4)
number_slider_6 = Slider(0.2, range=0..1)
panel_8 = Panel("Radius of dogbones")
circle = Circle(Plane=unit_y_2, Radius=number_slider_6)
circle_2 = Circle(Plane=PlaneXY(0, 0, 0), Radius=number_slider_6)
move_3 = Move(Geometry=[circle_2, circle], Motion=vector_xyz_2.Vector)  # -> Geometry, Transform

unit_y_3 = UnitY(Factor=number_slider_5)
panel_9 = Panel("Top slots")
move_4 = Move(Geometry=rotate.Geometry, Motion=unit_y_3)  # -> Geometry, Transform

cut_in_slots = Curve([linear_array.Geometry, move_4.Geometry])
cut_out_slots = Curve([rotate.Geometry, move_2.Geometry])
square = Curve(rectangle.Rectangle)

# ----
# Top and bottom dogbones
# Dogbones;
# need to be kept separate from slots because they shift differently than the rectangles
subtraction_5 = Subtraction(A=number_slider_5, B=number_slider)
addition_3 = Addition(A=number_slider_4, B=number_slider_4)
unit_y_4 = UnitY(Factor=addition_3)
unit_x_2 = UnitX(Factor=subtraction_5)
panel_10 = Panel("Left dogbones")
linear_array_2 = LinearArray(Geometry=move_3.Geometry, Direction=unit_y_4, Count=round.Floor)  # -> Geometry, Transform
panel_11 = Panel("Right dogbones")
move_5 = Move(Geometry=linear_array_2.Geometry, Motion=unit_x_2)  # -> Geometry, Transform
unit_y_5 = UnitY(Factor=number_slider_5)
rotate_2 = Rotate(Geometry=[move_5.Geometry, linear_array_2.Geometry], Angle=degrees(Slider(-90, range=-360..360)), Plane=PlaneXY(0, 0, 0))  # -> Geometry, Transform
move_6 = Move(Geometry=rotate_2.Geometry, Motion=unit_y_5)  # -> Geometry, Transform
dogbones = Curve([move_5.Geometry, linear_array_2.Geometry, move_6.Geometry])

trim_with_regions = TrimWithRegions(Curve=cut_in_slots, Regions=square)  # -> Inside, Outside
trim_with_regions_2 = TrimWithRegions(Curve=square, Regions=cut_in_slots)  # -> Inside, Outside
join_curves = JoinCurves(Curves=flatten([trim_with_regions.Inside, trim_with_regions_2.Outside]), Preserve=False)

trim_with_regions_3 = TrimWithRegions(Curve=square, Regions=cut_out_slots)  # -> Inside, Outside
trim_with_regions_4 = TrimWithRegions(Curve=cut_out_slots, Regions=square)  # -> Inside, Outside
join_curves_2 = JoinCurves(Curves=flatten([trim_with_regions_3.Outside, trim_with_regions_4.Outside]), Preserve=False)

# ----
# Trim slots into the square
# Trim the shared lines, joining the slots and the open lines of the square
# Trim slots out of the square
trim_with_regions_5 = TrimWithRegions(Curve=join_curves, Regions=cut_out_slots)  # -> Inside, Outside
trim_with_regions_6 = TrimWithRegions(Curve=join_curves_2, Regions=cut_in_slots)  # -> Inside, Outside

# ----
# Find overlapping (dupe) lines from the shape and remove them, then join the remaining curves
# https://parametricbydesign.com/grasshopper/how-tos/remove-duplicate-curves/
# Must flatten curve to put everything in same plane so dupe midpoint check will catch all lines
explode = Explode(Curve=trim_with_regions_6.Outside, Recursive=True)  # -> flatten(Segments), Vertices
explode_2 = Explode(Curve=trim_with_regions_5.Outside, Recursive=True)  # -> flatten(Segments), Vertices
point_on_curve = PointOnCurve([explode_2.Segments, explode.Segments], parameter=0.5)
cull_duplicates = CullDuplicates(Points=point_on_curve, Tolerance=0.1, CullMode=1)  # -> Points, Indices, Valence
list_item = ListItem(List=[explode_2.Segments, explode.Segments], Index=cull_duplicates.Indices, Wrap=True)
join_curves_3 = JoinCurves(Curves=flatten(list_item), Preserve=False)  # -> flatten(Curves)

# ----
# Trimming out and Joining dogbones
trim_with_regions_7 = TrimWithRegions(Curve=flatten(dogbones), Regions=flatten(join_curves_3))  # -> flatten(Inside), flatten(Outside)
trim_with_regions_8 = TrimWithRegions(Curve=flatten(join_curves_3), Regions=flatten(dogbones))  # -> flatten(Inside), flatten(Outside)
join_curves_4 = JoinCurves(Curves=[trim_with_regions_7.Inside, trim_with_regions_8.Outside], Preserve=False)
