# Grasshopper definition flower of life with outer ring.gh (Grasshopper 1.0.7)
# plug-ins: Anemone

number_of_circles_in_layer = Slider(2, range=0..10)
additional_circle_layers = Slider(4, range=0..4)
outset_scale = Slider(0.934, range=0..1)
radius_of_circles = Slider(11.07, range=0..20)
inset_scale = Slider(0.239, range=0..1)
center = Point(Point(-70.51162868, -85.61665974, 0))

# ----
# Creating Rings
scaled_offset_circles = ScaledOffsetCircles(outset_circle_scale_factor=outset_scale, plane=center, radius=radius_of_circles, inset_circle_scale_factor=inset_scale)  # -> outset_circle, scaled_offset_circles, inset_circle
divide_curve = DivideCurve(Curve=scaled_offset_circles.inset_circle, Count=number_of_circles_in_layer, Kinks=False)  # -> Points, Tangents, Parameters
panel = Panel("Using anemone loops")
loop_start = LoopStart(Repeat=additional_circle_layers, Points=divide_curve.Points)  # -> port, Counter, Points, Curve
scaled_offset_circles_2 = ScaledOffsetCircles(
    outset_circle_scale_factor=outset_scale,
    plane=loop_start.Points,
    radius=radius_of_circles,
    inset_circle_scale_factor=inset_scale)  # -> outset_circle, scaled_offset_circles, inset_circle
divide_curve_2 = DivideCurve(Curve=scaled_offset_circles_2.inset_circle, Count=number_of_circles_in_layer, Kinks=False)  # -> Points, Tangents, Parameters
cull_duplicates = CullDuplicates(Points=flatten(divide_curve_2.Points), Tolerance=0.1, CullMode=3)  # -> Points, Indices, Valence
loop_end = LoopEnd(
    port=loop_start.port,
    Exit=False,
    Points=cull_duplicates.Points,
    Curve=scaled_offset_circles_2.scaled_offset_circles,
    TimeOutVal=0,
    pausedState=False,
    state="Constant output")  # -> Points, Curve

# ----
# Scale the circle the same way to allow the "original" outer circle to set tangent to the "original" circles in the layer.
# 
# Without scaling, the outer circle and offset will be close but will not intersect tangentially.
# Creating Outer Ring
# The number of additional layers plus the 2 base layers;
# Times the radius of the circle
panel_2 = Panel("2")
addition = Addition(A=additional_circle_layers, B=panel_2)
multiplication = Multiplication(A=radius_of_circles, B=addition)
scaled_offset_circles_3 = ScaledOffsetCircles(outset_circle_scale_factor=outset_scale, plane=center, radius=multiplication, inset_circle_scale_factor=inset_scale)  # -> outset_circle, scaled_offset_circles, inset_circle

stream_filter = StreamFilter(Gate=Toggle(False), Stream1=scaled_offset_circles_3.scaled_offset_circles)
boundary_surfaces = BoundarySurfaces(Edges=[stream_filter, loop_end.Curve])

# ==== cluster ScaledOffsetCircles: Creates offset circles using the scale function rather than the offset function. Scaled offset circles perform better with Boundary Surface for creating lines for laser cutting.
inset_circle_scale_factor = ClusterInput()  # Factor that will impact the inset circle's scale
outset_circle_scale_factor = ClusterInput()  # Factor that will impact the outset circle's scale
addition = Addition(A=outset_circle_scale_factor, B=inset_circle_scale_factor)
subtraction = Subtraction(A=outset_circle_scale_factor, B=inset_circle_scale_factor)
radius = ClusterInput()
plane = ClusterInput()
circle = Circle(Plane=plane, Radius=radius)
original_circle = Scale(Geometry=circle, Center=circle, Factor=subtraction)  # -> graft(Geometry), Transform
offset_circle = Scale(Geometry=circle, Center=circle, Factor=addition)  # -> graft(Geometry), Transform
curve = Curve([offset_circle.Geometry, original_circle.Geometry])
scaled_offset_circles = ClusterOutput(curve)  # A single curve of two offset circles created via scaling rather than offsetting
outset_circle = ClusterOutput(offset_circle.Geometry)  # The circle offset to the outside of the original circle
inset_circle = ClusterOutput(original_circle.Geometry)  # The circle offset to the inside of the original circle
