# Grasshopper definition flower.gh (Grasshopper 1.0.7)
# plug-ins: Anemone

# https://www.youtube.com/watch?v=ciUgmOoRnF0&t=14s
panel = Panel("Shape radius")
panel_2 = Panel("Petal/circle divisions")
circle = Circle(Plane=PlaneXY(0, 0, 0), Radius=Slider(10, range=5..100))
divide_curve = DivideCurve(Curve=circle, Count=Slider(20, range=2..20), Kinks=False)  # -> Points, Tangents, Parameters
# Do not increase above ~20, will crash
panel_3 = Panel("Count")
loop_start = LoopStart(Repeat=Slider(10, range=0..20), Data=divide_curve.Points)  # -> port, Counter, flatten(Data), Data_2
polyline = PolyLine(Vertices=loop_start.Data, Closed=True)
explode = Explode(Curve=polyline, Recursive=True)  # -> Segments, Vertices

# ----
# Change this to make it more spiral
# Quadrilateral center width is extended in relation to the avg length of the other quadrilateral centers in the ring
point_on_curve = PointOnCurve(explode.Segments, parameter=0.5)
rotate = Rotate(Geometry=explode.Segments, Angle=1.570796327, Plane=point_on_curve)  # -> Geometry, Transform
length = Length(Curve=rotate.Geometry)
# "pointiness" of edge of petal, lower to be pointier
number_slider = Slider(2, range=1..10)
average = Average(Input=length)
division = Division(A=average, B=number_slider)
extend_curve = ExtendCurve(Curve=rotate.Geometry, Type=0, Start=division, End=Slider(0, range=0..1))

# ----
# Discontinuity of the quadrilateral geometry is 4 points, index 3 grabs the final, "inner" corner; need points for the return function of the loop
number_slider_2 = Slider(3, range=0..3)
settings_custom = SettingsCustom(
    StitchSeams=True,
    SimplePlanes=False,
    Refine=True,
    MinCount=16,
    MaxCount=400,
    AspectRatio=20,
    MaxDistance=0,
    MaxAngle=20,
    MinEdge=0,
    MaxEdge=Slider(0.5, range=0..1))

# ----
# How far up to turn the petal in the quadrilateral
number_slider_3 = Slider(0.08, range=0..0.1)
multiplication = Multiplication(A=loop_start.Counter, B=number_slider_3)
subtraction = Subtraction(A=Slider(0.9, range=0..1), B=multiplication)
unit_z = UnitZ(Factor=subtraction)

# ----
# Calculates how much to rotate the axis of each iteration of the loop based on the count
# The calculations here can make it flatter or more bowl shaped
number_slider_4 = Slider(1.9, range=0..10)
multiplication_2 = Multiplication(A=loop_start.Counter, B=number_slider_4)
subtraction_2 = Subtraction(A=Slider(10, range=0..360), B=multiplication_2)
negative = Negative(Value=subtraction_2)

# ----
# Graft to make the 4 pieces relate to eachother as a quadralateral rather than a big list
end_points = EndPoints(Curve=explode.Segments)  # -> graft(Start), graft(End)
end_points_2 = EndPoints(Curve=extend_curve)  # -> graft(Start), graft(End)
panel_4 = Panel("Create quadrilateral")

move = Move(Geometry=end_points_2.Start, Motion=unit_z)  # -> Geometry, Transform

merge = Merge(Data1=end_points.Start, Data2=move.Geometry, Data3=end_points.End, Data4=end_points_2.End)
polyline_2 = PolyLine(Vertices=merge, Closed=True)  # -> flatten(Polyline)

rotate_axis = RotateAxis(Geometry=polyline_2, Angle=degrees(negative), Axis=explode.Segments)  # -> Geometry, Transform

graft_tree = GraftTree(Tree=rotate_axis.Geometry, IncludeEmptyLists=True, IncludeNullItems=True)
discontinuity = Discontinuity(Curve=graft_tree, Level=1)  # -> Points, Parameters

list_item = ListItem(List=discontinuity.Points, Index=0, Wrap=True)  # -> Item, Item1, Item2, Item3
explode_2 = Explode(Curve=rotate_axis.Geometry, Recursive=True)  # -> Segments, Vertices
_4point_surface = _4PointSurface(CornerA=list_item.Item, CornerB=list_item.Item1, CornerC=list_item.Item2, CornerD=list_item.Item3)
point_on_curve_2 = PointOnCurve(explode_2.Segments, parameter=0.5)
panel_5 = Panel(" Inside curving brep")
brep_closest_point = BrepClosestPoint(Point=point_on_curve_2, Brep=_4point_surface)  # -> Point, Normal, Distance

# ----
# How scoopy the petals are. Lower makes them flatter, higher makes them more bowl-like
number_slider_5 = Slider(0.037, range=0..1)
# Scoopiness in relation to count
number_slider_6 = Slider(0.2, range=0..1)
multiplication_3 = Multiplication(A=loop_start.Counter, B=number_slider_5)
subtraction_3 = Subtraction(A=number_slider_6, B=multiplication_3)
negative_2 = Negative(Value=subtraction_3)
amplitude = Amplitude(Vector=brep_closest_point.Normal, Amplitude=negative_2)
move_2 = Move(Geometry=brep_closest_point.Point, Motion=amplitude)  # -> Geometry, Transform

graft_tree_2 = GraftTree(Tree=explode_2.Segments, IncludeEmptyLists=True, IncludeNullItems=True)

# ----
# Takes endpoints of the original quadrilaterals and ones we shifted down and combines them. Each item includes a start, and end, and a shifted point (n=3), due to grafting. Arcing creates an arched curve above each segment of the quadrilateral
end_points_3 = EndPoints(Curve=graft_tree_2)  # -> Start, End
graft_tree_3 = GraftTree(Tree=move_2.Geometry, IncludeEmptyLists=True, IncludeNullItems=True)
arc_3pt = Arc3Pt(PointA=end_points_3.Start, PointB=graft_tree_3, PointC=end_points_3.End)  # -> Arc, Plane, Radius
shift_paths = ShiftPaths(Data=arc_3pt.Arc, Offset=-1)
list_item_2 = ListItem(List=shift_paths, Index=0, Wrap=True)  # -> Item, Item1, Item2, Item3
panel_6 = Panel("Outside curving brep")
network_surface = NetworkSurface(CurvesU=[list_item_2.Item, list_item_2.Item2], CurvesV=[list_item_2.Item1, list_item_2.Item3], Continuity=2)

merge_2 = Merge(Data1=end_points_3.Start, Data2=graft_tree_3, Data3=end_points_3.End)
list_item_3 = ListItem(List=discontinuity.Points, Index=number_slider_2, Wrap=True)
# Number of Data input here needs to match the start; flatten the data to reflect starting input
loop_end = LoopEnd(
    port=loop_start.port,
    Exit=False,
    Data=flatten(list_item_3),
    Data_2=flatten(network_surface),
    TimeOutVal=0,
    pausedState=False,
    state="Constant & Record")  # -> Data, D1
surface = Surface(loop_end.D1)
brep_join = BrepJoin(Breps=flatten(surface))  # -> Breps, Closed
mesh_brep = MeshBrep(Brep=brep_join.Breps, Settings=settings_custom)
mesh_join = MeshJoin(Meshes=mesh_brep)
