# Grasshopper definition testing overlapped circles.gh (Grasshopper 1.0.7)
# plug-ins: Anemone

# ----
# Boundary Multiple Scaled Circles Built on 1 Scaled Circle; Anemone Loop Generation
# Use this process for multiple layers
number_of_circles_in_layer = Slider(5, range=0..10)
outset_scale = Slider(1, range=0..1)
additional_circle_layers = Slider(1, range=0..4)
radius_of_circles = Slider(7.49, range=0..20)
inset_scale = Slider(0.063, range=0..1)
center = Point(Point(-182.0143362, -130.5388421, 0))
scaled_offset_circles = ScaledOffsetCircles(outset_circle_scale_factor=outset_scale, plane=center, radius=radius_of_circles, inset_circle_scale_factor=inset_scale)  # -> outset_circle, scaled_offset_circles, inset_circle
divide_curve = DivideCurve(Curve=scaled_offset_circles.inset_circle, Count=number_of_circles_in_layer, Kinks=False)  # -> Points, Tangents, Parameters
panel = Panel("Using anemone loops")
loop_start = LoopStart(Repeat=additional_circle_layers, Points=divide_curve.Points)  # -> port, Counter, Points, Curve
scaled_offset_circles_2 = ScaledOffsetCircles(
    outset_circle_scale_factor=outset_scale,
    plane=loop_start.Points,
    radius=radius_of_circles,
    inset_circle_scale_factor=inset_scale)  # -> outset_circle, scaled_offset_circles, inset_circle
divide_curve_2 = DivideCurve(Curve=scaled_offset_circles_2.inset_circle, Count=number_of_circles_in_layer, Kinks=False)  # -> Points, Tangents, Parameters
cull_duplicates = CullDuplicates(Points=flatten(divide_curve_2.Points), Tolerance=0.1, CullMode=3)  # -> Points, Indices, Valence
loop_end = LoopEnd(
    port=loop_start.port,
    Exit=False,
    Points=cull_duplicates.Points,
    Curve=scaled_offset_circles_2.scaled_offset_circles,
    TimeOutVal=0,
    pausedState=False,
    state="Constant output")  # -> Points, Curve
boundary_surfaces = BoundarySurfaces(Edges=loop_end.Curve)

# ----
# Loft Multiple Scaled Circles Built on 1 Scaled Circle; Manually creating layers
# Geometries need to be grafted, not the boundary surface edges
# must be flattened, cull dupes should be at the end of the list
number_slider = Slider(0.05, range=0..1)
number_slider_2 = Slider(1, range=0..1)
number_slider_3 = Slider(10, range=0..10)
point = Point(Point(-4.775357217, -182.3714154, 0))
subtraction = Subtraction(A=number_slider_2, B=number_slider)
addition = Addition(A=number_slider_2, B=number_slider)
circle = Circle(Plane=point, Radius=number_slider_3)
number_slider_4 = Slider(5, range=0..10)
scale = Scale(Geometry=circle, Center=circle, Factor=subtraction)  # -> graft(Geometry), Transform
panel_2 = Panel("\"original\" circle")
divide_curve_3 = DivideCurve(Curve=scale.Geometry, Count=number_slider_4, Kinks=False)  # -> Points, Tangents, Parameters
circle_2 = Circle(Plane=divide_curve_3.Points, Radius=number_slider_3)
scale_2 = Scale(Geometry=circle_2, Center=circle_2, Factor=subtraction)  # -> graft(Geometry), Transform
divide_curve_4 = DivideCurve(Curve=scale_2.Geometry, Count=number_slider_4, Kinks=False)  # -> Points, Tangents, Parameters
cull_duplicates_2 = CullDuplicates(Points=flatten(divide_curve_4.Points), Tolerance=0.1, CullMode=3)  # -> Points, Indices, Valence
circle_3 = Circle(Plane=cull_duplicates_2.Points, Radius=number_slider_3)
panel_4 = Panel("\"offset\" circle")
scale_3 = Scale(Geometry=circle_3, Center=circle_3, Factor=subtraction)  # -> graft(Geometry), Transform
scale_4 = Scale(Geometry=circle_3, Center=circle_3, Factor=addition)  # -> graft(Geometry), Transform
curve = Curve([scale_4.Geometry, scale_3.Geometry])

loft = Loft(Curves=curve, Options={Adjust=False, Closed=False, LoftEnds=0, LoftSimp=0, LoftType=0, Rebuild=10, Refit=0.01})

# ----
# Boundary Surface 2 Circles
# flatten curve only cuts out the first circle created
number_slider_5 = Slider(2, range=0..10)
number_slider_6 = Slider(10, range=0..10)
point_2 = Point(Point(-52.88087023, -18.71682681, 0))
circle_4 = Circle(Plane=point_2, Radius=number_slider_6)
divide_curve_5 = DivideCurve(Curve=circle_4, Count=number_slider_5, Kinks=False)  # -> Points, Tangents, Parameters

circle_5 = Circle(Plane=divide_curve_5.Points, Radius=number_slider_6)
offset_curve = OffsetCurve(Curve=circle_5, Distance=1, Corners=1)

boundary_surfaces_2 = BoundarySurfaces(Edges=flatten([offset_curve, circle_5]))

# ----
# Loft 1 Circle
# flatten curves to get it to cut out middle circle
number_slider_7 = Slider(10, range=0..10)
point_3 = Point(Point(-10, 10, 0))

circle_6 = Circle(Plane=point_3, Radius=number_slider_7)
offset_curve_2 = OffsetCurve(Curve=circle_6, Distance=1, Corners=1)

loft_2 = Loft(
    Curves=flatten([circle_6, offset_curve_2]),
    Options={Adjust=False, Closed=False, LoftEnds=0, LoftSimp=0, LoftType=0, Rebuild=10, Refit=0.01})

# ----
# Boundary Surface multiple scaled circles built on 1 scaled circle
# Use this process, it is the most effective to get laser cut shapes
# To get the linework, it must be processed in Rhino.
# > Sel dupes and delete
# >Boolean Union (may take a bit the longer it goes)
# >Merge All faces
# Geometries need to be grafted, not the boundary surface edges
number_slider_8 = Slider(0.05, range=0..1)
number_slider_9 = Slider(1, range=0..1)
number_slider_10 = Slider(10, range=0..10)
point_4 = Point(Point(-63.40862448, -126.922471, 0))
addition_2 = Addition(A=number_slider_9, B=number_slider_8)
circle_7 = Circle(Plane=point_4, Radius=number_slider_10)
subtraction_2 = Subtraction(A=number_slider_9, B=number_slider_8)

scale_5 = Scale(Geometry=circle_7, Center=circle_7, Factor=addition_2)  # -> graft(Geometry), Transform
scale_6 = Scale(Geometry=circle_7, Center=circle_7, Factor=subtraction_2)  # -> graft(Geometry), Transform

# ----
# flatten boundary surface to get it to cut out middle circle
# Boundary Surface 1 Circle
number_slider_11 = Slider(10, range=0..10)
point_5 = Point(Point(-52.13447497, 10, 0))

circle_8 = Circle(Plane=point_5, Radius=number_slider_11)
offset_curve_3 = OffsetCurve(Curve=circle_8, Distance=1, Corners=1)

boundary_surfaces_3 = BoundarySurfaces(Edges=flatten([offset_curve_3, circle_8]))

# ----
# Loft multiple scaled circles built on 1 circle
# Geometries need to be grafted, not the loft curves
number_slider_12 = Slider(10, range=0..10)
point_6 = Point(Point(-8.745739873, -81.54159016, 0))
circle_9 = Circle(Plane=point_6, Radius=number_slider_12)
number_slider_13 = Slider(0.05, range=0..1)
number_slider_14 = Slider(1, range=0..1)
divide_curve_6 = DivideCurve(Curve=circle_9, Count=Slider(6, range=0..10), Kinks=False)  # -> Points, Tangents, Parameters
circle_10 = Circle(Plane=divide_curve_6.Points, Radius=Slider(10, range=0..10))
addition_3 = Addition(A=number_slider_14, B=number_slider_13)
subtraction_3 = Subtraction(A=number_slider_14, B=number_slider_13)

scale_7 = Scale(Geometry=circle_10, Center=circle_10, Factor=subtraction_3)  # -> graft(Geometry), Transform
scale_8 = Scale(Geometry=circle_10, Center=circle_10, Factor=addition_3)  # -> graft(Geometry), Transform

loft_3 = Loft(
    Curves=[scale_8.Geometry, scale_7.Geometry],
    Options={Adjust=False, Closed=False, LoftEnds=0, LoftSimp=0, LoftType=0, Rebuild=10, Refit=0.01})

# ----
# Boundary Surface multiple scaled circles built on 1 circle
# Geometries need to be grafted, not the boundary surface edges
number_slider_15 = Slider(10, range=0..10)
point_7 = Point(Point(-63.40862448, -81.23991741, 0))
circle_11 = Circle(Plane=point_7, Radius=number_slider_15)
number_slider_16 = Slider(1, range=0..1)
number_slider_17 = Slider(0.05, range=0..1)
divide_curve_7 = DivideCurve(Curve=circle_11, Count=Slider(7, range=0..10), Kinks=False)  # -> Points, Tangents, Parameters
circle_12 = Circle(Plane=divide_curve_7.Points, Radius=Slider(10, range=0..10))
addition_4 = Addition(A=number_slider_16, B=number_slider_17)
subtraction_4 = Subtraction(A=number_slider_16, B=number_slider_17)

scale_9 = Scale(Geometry=circle_12, Center=circle_12, Factor=subtraction_4)  # -> graft(Geometry), Transform
scale_10 = Scale(Geometry=circle_12, Center=circle_12, Factor=addition_4)  # -> graft(Geometry), Transform

boundary_surfaces_4 = BoundarySurfaces(Edges=[scale_10.Geometry, scale_9.Geometry])

# ----
# Loft Scaled Circles
# Does not need to be flattened
number_slider_18 = Slider(0.05, range=0..1)
number_slider_19 = Slider(1, range=0..1)
point_8 = Point(Point(-9.122593768, -43.51184044, 0))
circle_13 = Circle(Plane=point_8, Radius=Slider(10, range=0..10))
addition_5 = Addition(A=number_slider_19, B=number_slider_18)
subtraction_5 = Subtraction(A=number_slider_19, B=number_slider_18)

scale_11 = Scale(Geometry=circle_13, Center=circle_13, Factor=subtraction_5)  # -> Geometry, Transform
scale_12 = Scale(Geometry=circle_13, Center=circle_13, Factor=addition_5)  # -> Geometry, Transform

loft_4 = Loft(
    Curves=[scale_12.Geometry, scale_11.Geometry],
    Options={Adjust=False, Closed=False, LoftEnds=0, LoftSimp=0, LoftType=0, Rebuild=10, Refit=0.01})

# ----
# Loft 2 Circles
# Using graft, flatten, will not create the correct loft
number_slider_20 = Slider(10, range=0..10)
point_9 = Point(Point(-10, -18.71682681, 0))
circle_14 = Circle(Plane=point_9, Radius=number_slider_20)
divide_curve_8 = DivideCurve(Curve=circle_14, Count=Slider(2, range=0..10), Kinks=False)  # -> Points, Tangents, Parameters

circle_15 = Circle(Plane=divide_curve_8.Points, Radius=number_slider_20)
offset_curve_4 = OffsetCurve(Curve=circle_15, Distance=1, Corners=1)

loft_5 = Loft(
    Curves=[offset_curve_4, circle_15],
    Options={Adjust=False, Closed=False, LoftEnds=0, LoftSimp=0, LoftType=0, Rebuild=10, Refit=0.01})

# ----
# Boundary Surface Scaled Circles
# Does not need to be flattened
number_slider_21 = Slider(10, range=0..10)
number_slider_22 = Slider(0.05, range=0..1)
number_slider_23 = Slider(1, range=0..1)
point_10 = Point(Point(-52.13447497, -43.51184044, 0))
circle_16 = Circle(Plane=point_10, Radius=number_slider_21)
addition_6 = Addition(A=number_slider_23, B=number_slider_22)
subtraction_6 = Subtraction(A=number_slider_23, B=number_slider_22)

scale_13 = Scale(Geometry=circle_16, Center=circle_16, Factor=subtraction_6)  # -> Geometry, Transform
scale_14 = Scale(Geometry=circle_16, Center=circle_16, Factor=addition_6)  # -> Geometry, Transform

boundary_surfaces_5 = BoundarySurfaces(Edges=[scale_14.Geometry, scale_13.Geometry])

# ----
# Boundary Surface Multiple Scaled Circles Built on 1 Scaled Circle; Manually creating layers
# Geometries need to be grafted, not the boundary surface edges
# must be flattened, cull dupes should be at the end of the list
number_slider_24 = Slider(0.05, range=0..1)
number_slider_25 = Slider(1, range=0..1)
number_slider_26 = Slider(10, range=0..10)
point_11 = Point(Point(-63.40862448, -182.3714154, 0))
subtraction_7 = Subtraction(A=number_slider_25, B=number_slider_24)
addition_7 = Addition(A=number_slider_25, B=number_slider_24)
circle_17 = Circle(Plane=point_11, Radius=number_slider_26)
number_slider_27 = Slider(5, range=0..10)

scale_15 = Scale(Geometry=circle_17, Center=circle_17, Factor=subtraction_7)  # -> graft(Geometry), Transform

# ----
# This process is mostly the same as the boundary surface, but baking and then boolean unioning/merging faces causes odd behavior with the surface.
# 
# However, the linework remains the same once you dup face edge. Overall mostly the same as Boundary Surface
# Loft Surface Multiple Scaled Circles Built on 1 Scaled Circle
# Geometries need to be grafted, not the boundary surface edges
number_slider_28 = Slider(0.05, range=0..1)
number_slider_29 = Slider(1, range=0..1)
number_slider_30 = Slider(10, range=0..10)
point_12 = Point(Point(-3.045181906, -126.922471, 0))
addition_8 = Addition(A=number_slider_29, B=number_slider_28)
subtraction_8 = Subtraction(A=number_slider_29, B=number_slider_28)
circle_18 = Circle(Plane=point_12, Radius=number_slider_30)

scale_16 = Scale(Geometry=circle_18, Center=circle_18, Factor=addition_8)  # -> graft(Geometry), Transform
scale_17 = Scale(Geometry=circle_18, Center=circle_18, Factor=subtraction_8)  # -> graft(Geometry), Transform

divide_curve_9 = DivideCurve(Curve=scale_15.Geometry, Count=number_slider_27, Kinks=False)  # -> Points, Tangents, Parameters
circle_19 = Circle(Plane=divide_curve_9.Points, Radius=number_slider_26)

scale_18 = Scale(Geometry=circle_19, Center=circle_19, Factor=subtraction_7)  # -> graft(Geometry), Transform

divide_curve_10 = DivideCurve(Curve=scale_6.Geometry, Count=Slider(7, range=0..10), Kinks=False)  # -> Points, Tangents, Parameters
circle_20 = Circle(Plane=divide_curve_10.Points, Radius=number_slider_10)

scale_19 = Scale(Geometry=circle_20, Center=circle_20, Factor=subtraction_2)  # -> graft(Geometry), Transform
scale_20 = Scale(Geometry=circle_20, Center=circle_20, Factor=addition_2)  # -> graft(Geometry), Transform

boundary_surfaces_6 = BoundarySurfaces(Edges=[scale_20.Geometry, scale_19.Geometry])

divide_curve_11 = DivideCurve(Curve=scale_17.Geometry, Count=Slider(7, range=0..10), Kinks=False)  # -> Points, Tangents, Parameters
circle_21 = Circle(Plane=divide_curve_11.Points, Radius=number_slider_30)

scale_21 = Scale(Geometry=circle_21, Center=circle_21, Factor=subtraction_8)  # -> graft(Geometry), Transform
scale_22 = Scale(Geometry=circle_21, Center=circle_21, Factor=addition_8)  # -> graft(Geometry), Transform

loft_6 = Loft(
    Curves=[scale_21.Geometry, scale_22.Geometry],
    Options={Adjust=False, Closed=False, LoftEnds=0, LoftSimp=0, LoftType=0, Rebuild=10, Refit=0.01})

divide_curve_12 = DivideCurve(Curve=scale_18.Geometry, Count=number_slider_27, Kinks=False)  # -> Points, Tangents, Parameters
cull_duplicates_3 = CullDuplicates(Points=flatten(divide_curve_12.Points), Tolerance=0.1, CullMode=3)  # -> Points, Indices, Valence
circle_22 = Circle(Plane=cull_duplicates_3.Points, Radius=number_slider_26)

scale_23 = Scale(Geometry=circle_22, Center=circle_22, Factor=subtraction_7)  # -> graft(Geometry), Transform
scale_24 = Scale(Geometry=circle_22, Center=circle_22, Factor=addition_7)  # -> graft(Geometry), Transform

curve_2 = Curve([scale_24.Geometry, scale_23.Geometry])
boundary_surfaces_7 = BoundarySurfaces(Edges=curve_2)

# ==== cluster ScaledOffsetCircles: Creates offset circles using the scale function rather than the offset function. Scaled offset circles perform better with Boundary Surface for creating lines for laser cutting.
inset_circle_scale_factor = ClusterInput()  # Factor that will impact the inset circle's scale
outset_circle_scale_factor = ClusterInput()  # Factor that will impact the outset circle's scale
addition = Addition(A=outset_circle_scale_factor, B=inset_circle_scale_factor)
subtraction = Subtraction(A=outset_circle_scale_factor, B=inset_circle_scale_factor)
radius = ClusterInput()
plane = ClusterInput()
circle = Circle(Plane=plane, Radius=radius)
original_circle = Scale(Geometry=circle, Center=circle, Factor=subtraction)  # -> graft(Geometry), Transform
offset_circle = Scale(Geometry=circle, Center=circle, Factor=addition)  # -> graft(Geometry), Transform
curve = Curve([offset_circle.Geometry, original_circle.Geometry])
scaled_offset_circles = ClusterOutput(curve)  # A single curve of two offset circles created via scaling rather than offsetting
outset_circle = ClusterOutput(offset_circle.Geometry)  # The circle offset to the outside of the original circle
inset_circle = ClusterOutput(original_circle.Geometry)  # The circle offset to the inside of the original circle
