# Grasshopper definition snowflake.gh (Grasshopper 1.0.7)

# Amount to push the arm inside the center polygon, also impacts how far the arm is inside the outer polygon. Value of 0 means the arms are tangential on the tip of the polygon
number_slider = Slider(2, range=2..20)
number_slider_2 = Slider(8, range=3..10)
number_slider_3 = Slider(73, range=3..100)
panel = Panel("""Polygon size
& Polygon shape""")
panel_2 = Panel("Snowflake arm length")
subtraction = Subtraction(A=number_slider_3, B=number_slider)
# Starting point of the arms
construct_point = ConstructPoint(XCoordinate=subtraction, YCoordinate="0", ZCoordinate="0")
unit_x = UnitX(Factor=Slider(41, range=5..200))
polygon = Polygon(Plane=PlaneXY(0, 0, 0), Radius=number_slider_3, Segments=number_slider_2, FilletRadius=0)  # -> Polygon, Length
move = Move(Geometry=construct_point, Motion=unit_x)  # -> Geometry, Transform
line = Line(StartPoint=construct_point, EndPoint=move.Geometry)
panel_3 = Panel("Arm")
number_slider_4 = Slider(19, range=1..100)
panel_4 = Panel("Outer polygon size")
integer = Integer(move.Geometry)
addition = Addition(A=number_slider_4, B=integer)
subtraction_2 = Subtraction(A=addition, B=number_slider)
unit_x_2 = UnitX(Factor=subtraction_2)
# Outer polygon is same as inner, set at end of the arm
polygon_2 = Polygon(Plane=unit_x_2, Radius=number_slider_4, Segments=number_slider_2, FilletRadius=0)  # -> Polygon, Length
# Rotate 180, because odd sided polygons have the point facing the opposite direction. Rotating it orients the point of the polygon with the end of the line
rotate = Rotate(Geometry=polygon_2.Polygon, Angle=degrees(180), Plane=unit_x_2)  # -> Geometry, Transform
panel_5 = Panel("Fingers and arm")
panel_6 = Panel("Fillet radius")

# ---- group: Snowflake Fingers
# distance of first snowflake finger from center polygon's point
# multiplier of distance between fingers
# Mirror fingers across the arm
number_slider_5 = Slider(6, range=0..50)
number_slider_6 = Slider(31, range=0..50)
panel_7 = Panel("finger's length")
unit_x_3 = UnitX(Factor=number_slider_5)
vector_xyz = VectorXYZ(XComponent=number_slider_6, YComponent=number_slider_6, ZComponent=0)  # -> Vector, Length
# Lower number means fingers are closer together
number_slider_7 = Slider(2, range=0..5)
multiplication = Multiplication(A=number_slider_5, B=number_slider_7)
unit_x_4 = UnitX(Factor=multiplication)
panel_8 = Panel("extended finger length")
number_slider_8 = Slider(2.5, range=0..5)

# ---- group: Snowflake Fingers / Finger endpoints
move_2 = Move(Geometry=construct_point, Motion=unit_x_3)  # -> Geometry, Transform
# Fingers move in a slope of 1 direction
move_3 = Move(Geometry=move_2.Geometry, Motion=vector_xyz.Vector)  # -> Geometry, Transform

# ---- group: Snowflake Fingers (continued)
line_2 = Line(StartPoint=move_2.Geometry, EndPoint=move_3.Geometry)
move_4 = Move(Geometry=line_2, Motion=unit_x_4)  # -> Geometry, Transform
move_5 = Move(Geometry=move_4.Geometry, Motion=unit_x_4)  # -> Geometry, Transform

# ---- group: Snowflake Fingers / Farthest Finger
# additional finger length, compared to middle finger
number_slider_9 = Slider(0.4, range=0..1)
end_points = EndPoints(Curve=move_5.Geometry)  # -> Start, End
addition_2 = Addition(A=number_slider_8, B=number_slider_9)
scale = Scale(Geometry=move_5.Geometry, Center=end_points.Start, Factor=addition_2)  # -> Geometry, Transform

# ---- group: Snowflake Fingers / Middle finger
end_points_2 = EndPoints(Curve=move_4.Geometry)  # -> Start, End
scale_2 = Scale(Geometry=move_4.Geometry, Center=end_points_2.Start, Factor=number_slider_8)  # -> Geometry, Transform

# ---- group: Snowflake Fingers (continued)
curve = Curve(flatten([scale_2.Geometry, scale.Geometry, line_2]))
mirror_curve = MirrorCurve(Geometry=curve, Curve=line, Tangent=True)

# ----
# "Fatness" of the snowflake. Offset of each edge from the center of the shape.
# Offset the shapes to create something with thickness that could be cut with a laser or extruded with volume
number_slider_10 = Slider(10, range=0..10)
curve_2 = Curve(flatten([curve, mirror_curve, line]))
negative = Negative(Value=number_slider_10)
offset_curve = OffsetCurve(Curve=curve_2, Distance=number_slider_10, Corners=1)
offset_curve_2 = OffsetCurve(Curve=curve_2, Distance=negative, Corners=1)
loft = Loft(
    Curves=[offset_curve, offset_curve_2],
    Options={Adjust=False, Closed=False, LoftEnds=0, LoftSimp=0, LoftType=0, Rebuild=10, Refit=0.01})

# ----
# Unions the "thickness" that was created in the lof to create a single thick piece rather than individual overlapping fingers
# Union the arm and finger regions first so the fillet only effects those parts and not the end polygons
region_union = RegionUnion(Curves=flatten(loft))
fillet = Fillet(Curve=region_union, Radius=Slider(10, range=0..10))
# Polar array the outer polygon and the arms/fingers
polar_array = PolarArray(Geometry=[fillet, rotate.Geometry], Plane=PlaneXY(0, 0, 0), Count=number_slider_2, Angle=6.283185307)  # -> Geometry, Transform
boundary_surfaces = BoundarySurfaces(Edges=[polar_array.Geometry, polygon.Polygon])
# Flatten curve so they view eachother as a boundary of the same shape rather than individual shapes
region_union_2 = RegionUnion(Curves=flatten(boundary_surfaces))
curve_3 = Curve(region_union_2)
